# Grasshopper definition test_model.gh (Grasshopper 0.9.76)
# plug-ins: Karamba, RFEMmemberForces

loads = LoadsKaramba(ForceVector="0,0,-5", Local=False, PosInd="0,0,0", LCase="2", mode="Point")
beam_joints = BeamJointsKaramba(
    CtKNMAtStartingNode=Vector(0, 0, 0),
    CrKNmRadAtStartingNode=Vector(0, 0, 0),
    CtKNMAtEndNode=Vector(0, 0, 0),
    CrKNmRadAtEndNode=Vector(0, 0, 0),
    menu=[buttons(off, off, on, off, off, off), buttons(off, off, off, off, off, off)])
crosecrselect = CrossSectionRangeSelectorKaramba(MaximumHeight_cm=-1, MaximumWidth_cm=-1, menu=[dropdown(2), dropdown(3), dropdown(4)])
number_slider = Slider(10, range=0..10)
panel = Panel("""E1001
E1002""")
ln = Line(StartPoint="0,0,0", EndPoint="-3,0,0")
ln_2 = Line(StartPoint="0,0,0", EndPoint="3,0,0")
pt = Point("3,0,0")
pt_2 = Point("0,0,0")
matselect = MaterialSelectionKaramba(menu=[dropdown(2), dropdown(6)])
supp = SupportKaramba(PosInd=pt_2, menu=[buttons(off, on, on, on, off, on)])
loads_2 = LoadsKaramba(Vector="0,0,-5", BeamIdentifierS=panel, LCase="1", mode="Uniform Line", menu=[buttons(on, off, off)])
supp_2 = SupportKaramba(PosInd=pt, menu=[buttons(on, on, on, on, off, on)])
matselect_2 = MaterialSelectionKaramba(menu=[dropdown(3), dropdown(5)])
linetobeam = LineToBeamKaramba(Line=[ln_2, ln], New=True, Remove=True, LimitDistance_m=0.005, BeamIdentifier=panel)  # -> Points, Element, Info
item = ListItem(List=crosecrselect, Index=Slider(50, range=0..100), Wrap=True)
toggle = BooleanToggle(True)
orientate = OrientateBeamKaramba(Beam=linetobeam.Element, Alpha_deg="40")
nickname = UnlockRFEM(GO=toggle)
getcrosssectionnames = GetCrossSectionNames(GO=toggle)
cross_sections = CrossSectionsKaramba(
    ElementsIdentifiers=panel,
    Height_cm="100",
    UpperFlangeWidth_cm="200",
    LowerFlangeWidth_cm="300",
    UpperFlangeThickness_cm="5",
    LowerFlangeThickness_cm="6",
    SidewallsThickness_cm="7",
    FilletRadius_cm="3",
    mode="Box")
cross_sections_2 = CrossSectionsKaramba(ElementsIdentifiers=panel, Height_cm="100", UpperFlangeWidth_cm="200", LowerFlangeWidth_cm="300", mode="Trapezoid")
cross_sections_3 = CrossSectionsKaramba(
    ElementsIdentifiers=panel,
    Height_cm="100",
    UpperFlangeWidth_cm="200",
    LowerFlangeWidth_cm="300",
    UpperFlangeThickness_cm="5",
    LowerFlangeThickness_cm="6",
    WebThickness_cm="7",
    FilletRadius_cm="3",
    mode="I")
assemble = AssembleModelKaramba(
    Elem=orientate,
    Support=[supp, supp_2],
    Load=[loads_2, loads],
    CrossSection=cross_sections_3,
    Material=matselect,
    Joint=beam_joints,
    LimitDistance_m=0.005)  # -> Model, Info, Mass_kg, CenterOfGravity
analyzethi = AnalyzeThIKaramba(Model=assemble.Model)  # -> CalculatedModel, MaximumDisplacement_m, ResultingForceOfGravity_kN, ElasticEnergy_kNm
tk = TranslateKaramba(KarambaModel=assemble.Model, Excecute=Button(), KeepModelOpen=Toggle(False))
modelview = ModelViewKaramba(Model=analyzethi.CalculatedModel, LoadCaseFactorsForLinearSuperposition=1, IndexIncrementOfVisibleLoadcase=0)  # -> Model, DeformedMesh, DeformedAxes, DeformedModel
beamview = BeamViewKaramba(Model=modelview.Model)  # -> Model, MeshesOfRenderedBeams, DeformedBeamAxes, LegendColors, LegendTags
